# Grasshopper definition Ball_Test.gh (Grasshopper 1.0.7)
# plug-ins: TUNA, Kangaroo2 Components

# ---- group: Collision Geometry
number_slider = Slider(177, range=0..1000)
number_slider_2 = Slider(118, range=0..1000)
neg = Negative(Value=number_slider)
neg_2 = Negative(Value=number_slider_2)
pt = ConstructPoint(XCoordinate=neg, YCoordinate=neg_2, ZCoordinate=0)
pt_2 = ConstructPoint(XCoordinate=number_slider, YCoordinate=number_slider_2, ZCoordinate=Slider(10, range=0..100))
box = Box2Pt(PointA=pt, PointB=pt_2, Plane=PlaneXY(0, 0, 0))

# ---- group: Actions
panel = Panel("""-1
1
-1
1
-1
1""")
amount_of_rotation = Slider(15, range=0..15)
amount_of_translation = Slider(5, range=0..1000)
num = Number(panel)
multiplication = Multiplication(A=num, B=amount_of_rotation)
multiplication_2 = Multiplication(A=num, B=amount_of_translation)

# ---- group: ML Input
toggle = BooleanToggle(False)
toggle_2 = BooleanToggle(True)
button = Button()
button_2 = Button()
timer = Timer(TimerInterval=20, Target=tuna)
merge = Merge(Data1=multiplication, Data2=multiplication_2)
mesh = MeshBrep(
    Brep=box,
    Settings={GridMaxCount=0, GridMinCount=16, JaggedSeams=False, MaxEdgeLength=0, MinEdgeLength=0.0001, MinTolerance=0, Refine=True, RefineAngle=0, RelativeTolerance=0.65, SimplePlanes=True, Tolerance=0})
xy = XYPlane(Origin=Point(0, 0, 0))

# ----
tuna = TUNA(Action=merge, Move=toggle, Train=toggle_2, Reset=button, Clear=button_2, Plane=xy, Box=mesh)  # -> Action, Reset, State, Text

# ---- group: Kangaroo Setup
number_slider_3 = Slider(100, range=0..100)
pt_3 = ConstructPoint(XCoordinate=0, YCoordinate=0, ZCoordinate=number_slider_3)
xy_2 = XYPlane(Origin=pt_3)
msphere = MeshSphere(Base=xy_2, Radius=number_slider_3, UCount=10, VCount=20)
mesh_2 = Mesh(msphere)
rigidbody = RigidBody(Part=mesh_2, Strength=10)  # -> RigidBody, Planes
Z = UnitZ(Factor=-1)
pt_4 = Point(rigidbody.Planes)
solidplanecollide = SolidPlaneCollide(Solid=mesh_2, SolidPlane=rigidbody.Planes, CollisionPlane=tuna.Action, Strength=1)
load = Load(Point=pt_4, ForceVector=Z)

# ----
bouncysolver = BouncySolver(
    GoalObjects=flatten([solidplanecollide, rigidbody.RigidBody, load]),
    Reset=tuna.Reset,
    Threshold=1e-15,
    Tolerance=0.01,
    Damping=0.97,
    Iterations=20,
    On=toggle)  # -> I, V, O
panel_2 = Panel(tuna.Text)

# ---- group: Visualization
item = ListItem(List=bouncysolver.O, Index=1, Wrap=True)
pln = Plane(tuna.Action)
orient = Orient(Geometry=box, Source=xy, Target=pln)  # -> Geometry, Transform
volume = Volume(Geometry=item)  # -> Volume, Centroid
preview = CustomPreview(
    Geometry=item,
    Shader={diffuse=RGB(0, 192, 192), emission=RGB(0, 0, 0), shine=0.5, specular=RGB(255, 255, 255), transparency=0})

# ----
tuna_2 = TUNAGetState(BallPosition=volume.Centroid)
panel_3 = Panel(tuna_2)
panel_4 = Panel(tuna.State)
